# Grasshopper definition basic-image-sampler.gh (Grasshopper 1.0.7)

srf = Surface(<surface referenced from the Rhino model>)
number_slider = Slider(25, range=1..100)
# Basic Image Sampler (27 Oct 2019)
# by RJ Duran (rj.duran@colorado.edu)
# Critical Making Studio, Fall 2019
# http://make.cmci.studio
# Input: Subdivided Surface
# (Grid of Points)
number_slider_2 = Slider(0.57, range=0.125..1)
sdivide = DivideSurface(Surface=reparameterize(srf), UCount=number_slider, VCount=number_slider)  # -> Points, Normals, Parameters
points = PointList(Points=sdivide.Points, Size=number_slider_2)
pt = Point(sdivide.Parameters)
pt_2 = Point(sdivide.Points)
image = ImageSampler(
    pt,
    FilePath="/Users/rjduran/code/cm-design/grasshopper/image-sampler/tiger-crop2.jpg",
    Filter="Value",
    Interpolate=False,
    Umax=1,
    Umin=0,
    Vmax=1,
    Vmin=0,
    Wrap=0)
dom = ConstructDomain(DomainStart=Slider(0, range=0..1), DomainEnd=Slider(0.1, range=0..1))
remap = RemapNumbers(Value=image, Source=Domain(0, 1), Target=dom)  # -> Mapped, Clipped
cir = Circle(Plane=pt_2, Radius=remap.Mapped)
flatten = FlattenTree(Tree=cir, Path="{0}")
# Output: Circles at each point
boundary = BoundarySurfaces(Edges=cir)

# ---- group: Bake Me!
# Grouped curves
group = Group(Objects=flatten)

# ----
preview = CustomPreview(Geometry=boundary, Material=ColourSwatch(SwatchColor=RGB(0, 0, 0)))
