# Grasshopper definition vase-builder.gh (Grasshopper 0.9.80)
# plug-ins: Bifocals

# ---- group: Top Polygon
# Vase Builder (v1.0, 24 Oct 2018)
# by RJ Duran (rj.duran@colorado.edu)
# Critical Making Studio, Fall 2018
# http://make.cmci.studio
radius = Slider(20, range=1..21)
# Top Polygon
sides = Slider(6, range=3..21)
polygon = Polygon(Plane=PlaneXY(0, 0, 0), Radius=radius, Segments=sides, FilletRadius=Slider(1, range=0..1))  # -> Polygon, Length
unit_z = UnitZ(Factor=Slider(50, range=0..100))
# Uses Bifocals plugin
# https://www.food4rhino.com/app/bifocals
move = Move(Geometry=polygon.Polygon, Motion=unit_z)  # -> Geometry, Transform

# ---- group: Bottom Polygon
# Bottom Polygon
radius_2 = Slider(14, range=1..21)
sides_2 = Slider(6, range=3..21)
polygon_2 = Polygon(Plane=PlaneXY(0, 0, 0), Radius=radius_2, Segments=sides_2, FilletRadius=Slider(1, range=0..1))  # -> Polygon, Length

# ----
index = Panel("1")
offset_amount = Panel("-1")
index_2 = Panel("1")

# ---- group: Middle Polygon
radius_3 = Slider(12, range=1..21)
sides_3 = Slider(6, range=3..21)
# Middle Polygon
number_slider = Slider(1, range=0..1)
rotate = Slider(10, range=-180..180)
radians = Radians(Degrees=rotate)
polygon_3 = Polygon(Plane=PlaneXY(0, 0, 0), Radius=radius_3, Segments=sides_3, FilletRadius=number_slider)  # -> Polygon, Length
unit_z_2 = UnitZ(Factor=Slider(12.632, range=0..50))

# ----
rotate_2 = Rotate(Geometry=polygon_3.Polygon, Angle=radians, Plane=PlaneXY(0, 0, 0))  # -> Geometry, Transform

# ---- group: Middle Polygon (continued)
move_2 = Move(Geometry=rotate_2.Geometry, Motion=unit_z_2)  # -> Geometry, Transform

# ---- group: Offset Curves
wall_thickness = Slider(1, range=1..4)
offset = Offset(Curve=move.Geometry, Distance=wall_thickness, Plane=PlaneXY(0, 0, 0), Corners=1)
offset_2 = Offset(Curve=move_2.Geometry, Distance=wall_thickness, Plane=PlaneXY(0, 0, 0), Corners=1)
offset_3 = Offset(Curve=polygon_2.Polygon, Distance=wall_thickness, Plane=PlaneXY(0, 0, 0), Corners=1)

# ---- group: Outside Surface Curves
# Set of offset curves for lofting
# the outside surface.
curve = Curve([offset_3, offset_2, offset])

# ---- group: Inside Surface Curves
# Set of curves for lofting
# the inside surface.
curve_2 = Curve([polygon_2.Polygon, move_2.Geometry, move.Geometry])

# ---- group: Top Surface
ruled_surface = RuledSurface(CurveA=move.Geometry, CurveB=offset)

# ---- group: Bottom Surface
# All surfaces to join into one surface.
# Inside surface is modified further to
# give the same thickness to the base
# as the walls have.
boundary_surfaces = BoundarySurfaces(Edges=offset_3)

# ---- group: Inside Surface (Original)
inside_surfac = Loft(Curves=curve_2, Options={Adjust=False, Closed=False, LoftEnds=0, LoftSimp=0, LoftType=0, Rebuild=10, Refit=0.01})

# ---- group: Outside Surface
loft = Loft(Curves=curve, Options={Adjust=False, Closed=False, LoftEnds=0, LoftSimp=0, LoftType=0, Rebuild=10, Refit=0.01})

# ----
# Create contours and select the contour
# with index=1 to use as the bottom of
# the inside (loft) surface.
contour = Contour(Shape=inside_surfac, Point=Point(0, 0, 0), Direction=Vector(0, 0, 1), Distance=wall_thickness)
# Flatten the data tree from a branch
# structure coming out of the contour
# component into a single list of curves.
panel = Panel(contour)
flatten_tree = FlattenTree(Tree=contour, Path="{0}")
list_item = ListItem(List=flatten_tree, Index=index, Wrap=True)
panel_2 = Panel(flatten_tree)
# Offset the selected contour just
# enough to use as a cutting surface
# in Split Brep component.
# 
# Select the Brep with index=1 resulting from the split component.
offset_4 = Offset(Curve=list_item, Distance=offset_amount, Plane=PlaneXY(0, 0, 0), Corners=1)
boundary_surfaces_2 = BoundarySurfaces(Edges=offset_4)
split_brep = SplitBrep(Brep=inside_surfac, Cutter=boundary_surfaces_2)

# ---- group: Inside Bottom Surface
boundary_surfaces_3 = BoundarySurfaces(Edges=list_item)

# ---- group: Inside Surface (Cropped)
list_item_2 = ListItem(List=split_brep, Index=index_2, Wrap=True)

# ---- group: Final Surface List
# Group all final surfaces and flatten
# into a list to join and bake.
brep = Brep([ruled_surface, list_item_2, boundary_surfaces_3, loft, boundary_surfaces])

# ---- group: Final Object (Bake Me!)
# Bake Me!
brep_join = BrepJoin(Breps=flatten(brep))  # -> Breps, Closed
